% Simulink data dictionary data.sldd

J = Simulink.Parameter(3.228e-6)
Kd = Simulink.Parameter(49.1069)
Ke = Simulink.Parameter(0.0274)
Ki = Simulink.Parameter(3.902604e+09)
Kp = Simulink.Parameter(881695.95)
Kt = Simulink.Parameter(0.0274)
L = Simulink.Parameter(2.75e-6)
R = Simulink.Parameter(4)
b = Simulink.Parameter(3.5077e-6)